# Grasshopper definition prompt.gh (Grasshopper 1.0.8)
# plug-ins: RhinoCodePluginGH

python_3_script = Python3Script(prompt="I work from 9am to 5pm and do yoga at 9pm")  # -> a, b, c
# ---------- python_3_script: Python ----------
import requests
import json

url = "http://127.0.0.1:5000/extract_activities"

try:
    r = requests.post(url, json={"prompt": prompt})
    r.raise_for_status()
    activities_json = r.json()["activities"]
    activities = json.loads(activities_json)
    # Convert list of dicts to a readable string for the panel
    activities_str = [f"{a['activity']}: {a['hours']}" for a in activities]
    # Convert hours to string too
    hours_str = [str(a["hours"]) for a in activities]
except Exception as e:
    activities_json = str(e)
    activities_str = []
    hours_str = []

# For outputs, use the string versions:
a = activities_json
b = activities_str
c = hours_str
# ---------- end python_3_script ----------
panel = Panel(python_3_script.a)
hours = Panel(python_3_script.c)
activities = Panel(python_3_script.b)
